# Grasshopper definition Comoda Ravenna.ghx (Grasshopper 1.0.8)

# ---- group: Dimensões principais
rh_in_01_2_profundidad_475 = Slider(475, range=200..600)
rh_in_01_1_altura_930 = Slider(930, range=400..1200)
rh_in_01_0_ancho_1295 = Slider(905, range=300..1600)
subtraction = Subtraction(A=rh_in_01_1_altura_930)
domain_box = DomainBox(Base=PlaneXY(0, 0, 0), X=rh_in_01_0_ancho_1295, Y=rh_in_01_2_profundidad_475, Z=subtraction)

# ----
expression = Expression(
    x=rh_in_01_1_altura_930,
    y=rh_in_01_0_ancho_1295,
    Expression="if(x ≤ 500, 1, if(x ≤ 800, 2, if(x ≤ 1000, 3, if(x ≤ 1200, 4, 0))))")
area = Area(Geometry=domain_box)  # -> Area, Centroid
cantidad_cajones = Panel(expression)
yz_plane = YZPlane(Origin=area.Centroid)
deconstruct_brep = DeconstructBrep(Brep=domain_box)  # -> Faces, Edges, Vertices
altura_pata = Panel("50")
list_item = ListItem(List=deconstruct_brep.Vertices, Index="0", Wrap=True)
unit_z = UnitZ(Factor=altura_pata)
move = Move(Geometry=list_item, Motion=unit_z)  # -> Geometry, Transform
desfase = Panel("16")
unit_x = UnitX(Factor=desfase)
list_item_2 = ListItem(List=move.Geometry, Index="4", Wrap=True)
move_2 = Move(Geometry=list_item_2, Motion=unit_x)  # -> Geometry, Transform
unit_y = UnitY(Factor="20")
move_3 = Move(Geometry=move_2.Geometry, Motion=unit_y)  # -> Geometry, Transform
unit_y_2 = UnitY(Factor="3")
rh_in_01_4_altura_zocalo = Slider(73, range=50..120)
unit_y_3 = UnitY(Factor="12")
unit_z_2 = UnitZ(Factor=rh_in_01_4_altura_zocalo)
unit_z_3 = UnitZ(Factor=rh_in_01_4_altura_zocalo)
unit_y_4 = UnitY(Factor="3")
unit_z_4 = UnitZ(Factor="12")
unit_z_5 = UnitZ(Factor=rh_in_01_4_altura_zocalo)
addition = Addition(A=rh_in_01_4_altura_zocalo, B="12")

mesh = Mesh(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)
point = Point(Point(-186.6000977, 13, 50))

unit_z_6 = UnitZ(Factor=addition)
unit_y_5 = UnitY(Factor="80")
unit_z_7 = UnitZ(Factor="32")
unit_y_6 = UnitY(Factor="0.6")
rh_in_01_5_posicion_pata = ValueList({"1": 0, "2": 1}, selected="2")
unit_x_2 = UnitX(Factor="-43.5")
unit_z_8 = UnitZ(Factor="8")
panel = Panel(cantidad_cajones)
unit_x_3 = UnitX(Factor="-4")
unit_y_7 = UnitY(Factor="-0.6")
unit_y_8 = UnitY(Factor="-0.6")
unit_z_9 = UnitZ(Factor="20")
unit_z_10 = UnitZ(Factor="20")
subtraction_2 = Subtraction(A=cantidad_cajones, B="1")
negative = Negative(Value="4")
unit_x_4 = UnitX(Factor=negative)
unit_x_5 = UnitX(Factor="4")
multiplication = Multiplication(A=subtraction_2, B="36")
unit_y_9 = UnitY(Factor="-0.6")
unit_y_10 = UnitY(Factor="-0.6")
unit_z_11 = UnitZ(Factor="20")
unit_z_12 = UnitZ(Factor="20")
unit_y_11 = UnitY(Factor="-15")
unit_x_6 = UnitX(Factor="-4")
unit_x_7 = UnitX(Factor="4")
subtraction_3 = Subtraction(A=cantidad_cajones, B="1")
multiplication_2 = Multiplication(A=subtraction_3, B="36")
unit_y_12 = UnitY(Factor="-15")
unit_y_13 = UnitY(Factor="-10")
unit_x_8 = UnitX(Factor="14")
rh_in_02_0_altura_lateral_de_cajon = ValueList({"80", "110", "120"}, selected="110")
unit_z_13 = UnitZ(Factor="17.5")
unit_z_14 = UnitZ(Factor="-20")
unit_z_15 = UnitZ(Factor="30")
unit_z_16 = UnitZ(Factor="34")
unit_x_9 = UnitX(Factor="4")
unit_z_17 = UnitZ(Factor=rh_in_02_0_altura_lateral_de_cajon)
unit_x_10 = UnitX(Factor="-4")
unit_x_11 = UnitX(Factor="12")
unit_y_14 = UnitY(Factor="-6")

_02_2_desfase = Slider(0, range=0..20)
_01_2_altura = Slider(9, range=0..20)

unit_y_15 = UnitY(Factor="350")
unit_y_16 = UnitY(Factor="12")
unit_z_18 = UnitZ(Factor="-11.1")
unit_y_17 = UnitY(Factor="-9")
unit_z_19 = UnitZ(Factor="12.5")
rh_in_02_1_ritmo = ValueList({"32", "64", "96"}, selected="64")
unit_z_20 = UnitZ(Factor=rh_in_02_1_ritmo)
negative_2 = Negative(Value=unit_z_20)

# ---- group: Fondo
box_2pt = Box2Pt(Plane=PlaneXY(0, 0, 0))

# ----
point_2 = Point(Point(-312.5, 12.5, 0))
cavilha = Mesh(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)

cantoneira = Mesh(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)
parafuso_e = Mesh([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])
point_3 = Point(Point(-368, 0, 7))

maquinados = Brep([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])
corredeça = Mesh(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)
corredeça_2 = Mesh(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)
corredeça_3 = Mesh(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)
point_4 = Point(Point(-420, 0, 0))

corredeça_4 = Mesh(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)
unit_z_21 = UnitZ(Factor=rh_in_02_1_ritmo)
negative_3 = Negative(Value=unit_z_21)
unit_x_12 = UnitX(Factor="-0.4")
rh_in_03_0_peça_7 = ValueList({"Atravesada": 0, "Longitudinal": 1}, selected="Longitudinal")
rh_in_03_0_equilíbrio_peça_7 = ValueList({"Lado 1": 3, "Lado 2": 1, "2 lados": 6}, selected="Lado 2")
rh_in_03_0_peça_6 = ValueList({"Atravesada": 0, "Longitudinal": 1}, selected="Longitudinal")
rh_in_03_0_equilíbrio_peça_6 = ValueList({"Lado 1": 3, "Lado 2": 1, "2 lados": 6}, selected="Lado 2")
rh_in_03_0_equilíbrio_peça_10 = ValueList({"Lado 1": 3, "Lado 2": 1, "2 lados": 6}, selected="Lado 2")
rh_in_03_0_peça_10 = ValueList({"Atravesada": 0, "Longitudinal": 1}, selected="Longitudinal")

# ----
# Multiplocador de Verticales
panel_2 = Panel("6")

# ----
# Tablero Superior
panel_3 = Panel("6")
unit_z_22 = UnitZ(Factor="-15")
list_item_3 = ListItem(List=deconstruct_brep.Vertices, Index="4", Wrap=True)
list_item_4 = ListItem(List=deconstruct_brep.Vertices, Index=panel_3, Wrap=True)
move_4 = Move(Geometry=list_item_3, Motion=unit_z_22)  # -> Geometry, Transform
addition_2 = Addition(A=desfase, B="12")
unit_x_13 = UnitX(Factor=addition_2)

# ---- group: Peca 13
box_2pt_2 = Box2Pt(PointA=move_4.Geometry, PointB=list_item_4, Plane=PlaneXY(0, 0, 0))

# ----
deconstruct_brep_2 = DeconstructBrep(Brep=box_2pt_2)  # -> Faces, Edges, Vertices
list_item_5 = ListItem(List=deconstruct_brep_2.Vertices, Index="3", Wrap=True)
move_5 = Move(Geometry=list_item_5, Motion=unit_x_13)  # -> Geometry, Transform

box_2pt_3 = Box2Pt(PointA=move_3.Geometry, PointB=move_5.Geometry, Plane=PlaneXY(0, 0, 0))

deconstruct_brep_3 = DeconstructBrep(Brep=box_2pt_3)  # -> Faces, Edges, Vertices

# ---- group: Peca 10
mirror = Mirror(Geometry=box_2pt_3, Plane=yz_plane)  # -> Geometry, Transform

# ----
deconstruct_brep_4 = DeconstructBrep(Brep=mirror.Geometry)  # -> Faces, Edges, Vertices
deconstruct_brep_5 = DeconstructBrep(Brep=box_2pt_3)  # -> Faces, Edges, Vertices
list_item_6 = ListItem(List=deconstruct_brep_5.Edges, Index="2", Wrap=True)
list_item_7 = ListItem(List=deconstruct_brep_4.Edges, Index=panel_2, Wrap=True)
curve_middle = CurveMiddle(Curve=list_item_6)
curve_middle_2 = CurveMiddle(Curve=list_item_7)
distance = Distance(PointA=curve_middle, PointB=curve_middle_2)
expression_2 = Expression(x=distance, y=rh_in_01_0_ancho_1295, Expression="if(x<700, 1,2)")
division = Division(A=distance, B=expression_2)
unit_x_14 = UnitX(Factor=division)
stream_gate = StreamGate(Segmentos=unit_x_14, Gate=expression_2)  # -> Target0, Target1, Target2, Target3, Target4

move_6 = Move(Geometry=box_2pt_3, Motion=stream_gate.Target2)  # -> Geometry, Transform

list_item_8 = ListItem(List=deconstruct_brep_3.Vertices, Index="1", Wrap=True)
deconstruct_brep_6 = DeconstructBrep(Brep=move_6.Geometry)  # -> Faces, Edges, Vertices
move_7 = Move(Geometry=list_item_8, Motion=unit_y_2)  # -> Geometry, Transform
deconstruct_brep_7 = DeconstructBrep(Brep=mirror.Geometry)  # -> Faces, Edges, Vertices
list_item_9 = ListItem(List=deconstruct_brep_3.Edges, Index="1", Wrap=True)
list_item_10 = ListItem(List=deconstruct_brep_6.Vertices, Index="0", Wrap=True)
list_item_11 = ListItem(List=deconstruct_brep_6.Vertices, Index="6", Wrap=True)
move_8 = Move(Geometry=move_7.Geometry, Motion=unit_y_3)  # -> Geometry, Transform
list_item_12 = ListItem(List=deconstruct_brep_7.Vertices, Index="5", Wrap=True)
move_9 = Move(Geometry=list_item_8, Motion=unit_z_2)  # -> Geometry, Transform
curve_middle_3 = CurveMiddle(Curve=list_item_9)
move_10 = Move(Geometry=move_8.Geometry, Motion=unit_z_3)  # -> Geometry, Transform
move_11 = Move(Geometry=list_item_12, Motion=unit_y_4)  # -> Geometry, Transform
xz_plane = XZPlane(Origin=curve_middle_3)
vector_2pt = Vector2Pt(PointA=point, PointB=move_8.Geometry, Unitize=False)  # -> Vector, Length
move_12 = Move(Geometry=move_9.Geometry, Motion=unit_z_4)  # -> Geometry, Transform
move_13 = Move(Geometry=list_item_12, Motion=unit_z_5)  # -> Geometry, Transform
move_14 = Move(Geometry=mesh, Motion=vector_2pt.Vector)  # -> Geometry, Transform
move_15 = Move(Geometry=list_item_10, Motion=unit_z_6)  # -> Geometry, Transform
move_16 = Move(Geometry=move_12.Geometry, Motion=unit_y_5)  # -> Geometry, Transform

# ---- group: Peca 6
box_2pt_4 = Box2Pt(PointA=move_15.Geometry, PointB=list_item_11, Plane=PlaneXY(0, 0, 0))

# ---- group: Peca 1
box_2pt_5 = Box2Pt(PointA=move_10.Geometry, PointB=move_11.Geometry, Plane=PlaneXY(0, 0, 0))

# ----
unit_y_18 = UnitY(Factor="-1")
list_item_13 = ListItem(List=deconstruct_brep_3.Vertices, Index="6", Wrap=True)
move_17 = Move(Geometry=list_item_13, Motion=unit_y_18)  # -> Geometry, Transform
unit_z_23 = UnitZ(Factor="-120")
move_18 = Move(Geometry=move_17.Geometry, Motion=unit_z_23)  # -> Geometry, Transform
unit_y_19 = UnitY(Factor="-12")
move_19 = Move(Geometry=move_18.Geometry, Motion=unit_y_19)  # -> Geometry, Transform

# ---- group: Peca 3
mirror_2 = Mirror(Geometry=box_2pt_5, Plane=xz_plane)  # -> Geometry, Transform

# ----
deconstruct_brep_8 = DeconstructBrep(Brep=box_2pt_5)  # -> Faces, Edges, Vertices
list_item_14 = ListItem(List=deconstruct_brep_8.Edges, Index="2", Wrap=True)
curve_middle_4 = CurveMiddle(Curve=list_item_14)
unit_x_15 = UnitX(Factor="6")
move_20 = Move(Geometry=curve_middle_4, Motion=unit_x_15)  # -> Geometry, Transform

unit_y_20 = UnitY(Factor="-1")
list_item_15 = ListItem(List=deconstruct_brep_6.Vertices, Index="7", Wrap=True)
move_21 = Move(Geometry=list_item_15, Motion=unit_y_20)  # -> Geometry, Transform

unit_y_21 = UnitY(Factor="-1")
list_item_16 = ListItem(List=deconstruct_brep_6.Vertices, Index="6", Wrap=True)
move_22 = Move(Geometry=list_item_16, Motion=unit_y_21)  # -> Geometry, Transform
unit_z_24 = UnitZ(Factor="-120")
move_23 = Move(Geometry=move_22.Geometry, Motion=unit_z_24)  # -> Geometry, Transform
unit_y_22 = UnitY(Factor="-12")
move_24 = Move(Geometry=move_23.Geometry, Motion=unit_y_22)  # -> Geometry, Transform

deconstruct_brep_9 = DeconstructBrep(Brep=mirror_2.Geometry)  # -> Faces, Edges, Vertices
list_item_17 = ListItem(List=deconstruct_brep_9.Edges, Index="2", Wrap=True)
curve_middle_5 = CurveMiddle(Curve=list_item_17)
unit_x_16 = UnitX(Factor="-6")
move_25 = Move(Geometry=curve_middle_5, Motion=unit_x_16)  # -> Geometry, Transform

# ---- group: Peca 4
box_2pt_6 = Box2Pt(PointA=move_16.Geometry, PointB=move_13.Geometry, Plane=PlaneXY(0, 0, 0))

# ----
yz_plane_2 = YZPlane(Origin=curve_middle_4)
mirror_3 = Mirror(Geometry=move_14.Geometry, Plane=yz_plane_2)  # -> Geometry, Transform
deconstruct_brep_10 = DeconstructBrep(Brep=box_2pt_6)  # -> Faces, Edges, Vertices

# ---- group: Peca 5
mirror_4 = Mirror(Geometry=box_2pt_6, Plane=xz_plane)  # -> Geometry, Transform

# ----
unit_y_23 = UnitY(Factor="-1")
list_item_18 = ListItem(List=deconstruct_brep_7.Vertices, Index="2", Wrap=True)
move_26 = Move(Geometry=list_item_18, Motion=unit_y_23)  # -> Geometry, Transform

list_item_19 = ListItem(List=deconstruct_brep_10.Vertices, Index="4", Wrap=True)

unit_y_24 = UnitY(Factor="0.6")
list_item_20 = ListItem(List=deconstruct_brep_3.Vertices, Index="5", Wrap=True)
move_27 = Move(Geometry=list_item_20, Motion=unit_y_24)  # -> Geometry, Transform
unit_z_25 = UnitZ(Factor="-60")
move_28 = Move(Geometry=move_27.Geometry, Motion=unit_z_25)  # -> Geometry, Transform
unit_y_25 = UnitY(Factor="12")
move_29 = Move(Geometry=move_28.Geometry, Motion=unit_y_25)  # -> Geometry, Transform

move_30 = Move(Geometry=list_item_19, Motion=unit_z_7)  # -> Geometry, Transform

unit_y_26 = UnitY(Factor="0.6")
list_item_21 = ListItem(List=deconstruct_brep_6.Vertices, Index="4", Wrap=True)
move_31 = Move(Geometry=list_item_21, Motion=unit_y_26)  # -> Geometry, Transform

unit_y_27 = UnitY(Factor="0.6")
list_item_22 = ListItem(List=deconstruct_brep_6.Vertices, Index="5", Wrap=True)
move_32 = Move(Geometry=list_item_22, Motion=unit_y_27)  # -> Geometry, Transform
unit_z_26 = UnitZ(Factor="-60")
move_33 = Move(Geometry=move_32.Geometry, Motion=unit_z_26)  # -> Geometry, Transform
unit_y_28 = UnitY(Factor="12")
move_34 = Move(Geometry=move_33.Geometry, Motion=unit_y_28)  # -> Geometry, Transform

box_2pt_7 = Box2Pt(PointA=move_19.Geometry, PointB=move_21.Geometry, Plane=PlaneXY(0, 0, 0))
box_2pt_8 = Box2Pt(PointA=move_20.Geometry, PointB=move_25.Geometry, Plane=PlaneXY(0, 0, 0))
box_2pt_9 = Box2Pt(PointA=move_24.Geometry, PointB=move_26.Geometry, Plane=PlaneXY(0, 0, 0))
move_35 = Move(Geometry=move_30.Geometry, Motion=unit_y_6)  # -> Geometry, Transform
box_2pt_10 = Box2Pt(PointA=move_19.Geometry, PointB=move_26.Geometry, Plane=PlaneXY(0, 0, 0))
stream_filter = StreamFilter(Gate=expression_2, Stream1=box_2pt_10, Stream2=[box_2pt_9, box_2pt_7])

unit_y_29 = UnitY(Factor="0.6")
list_item_23 = ListItem(List=deconstruct_brep_7.Vertices, Index="1", Wrap=True)
move_36 = Move(Geometry=list_item_23, Motion=unit_y_29)  # -> Geometry, Transform

move_37 = Move(Geometry=box_2pt_8, Motion=unit_x_2)  # -> Geometry, Transform
line = Line(StartPoint=move_27.Geometry, EndPoint=move_35.Geometry)
dispatch = Dispatch(List=stream_filter, DispatchPattern=[True, False])  # -> ListA, ListB
length = Length(Curve=line)
stream_filter_2 = StreamFilter(Gate=rh_in_01_5_posicion_pata, Stream0=box_2pt_8, Stream1=move_37.Geometry)

# ---- group: Peca 12
brep = Brep(dispatch.ListA)

# ----
box_2pt_11 = Box2Pt(PointA=move_29.Geometry, PointB=move_31.Geometry, Plane=PlaneXY(0, 0, 0))

# ---- group: Peca 9
brep_2 = Brep(dispatch.ListB)

# ---- group: Peca 2
stream_filter_3 = StreamFilter(Gate=expression_2, Stream2=stream_filter_2)

# ----
division_2 = Division(A=length, B=cantidad_cajones)
box_2pt_12 = Box2Pt(PointA=move_29.Geometry, PointB=move_36.Geometry, Plane=PlaneXY(0, 0, 0))
box_2pt_13 = Box2Pt(PointA=move_34.Geometry, PointB=move_36.Geometry, Plane=PlaneXY(0, 0, 0))
deconstruct_brep_11 = DeconstructBrep(Brep=stream_filter_3)  # -> Faces, Edges, Vertices
panel_4 = Panel(division_2)
list_item_24 = ListItem(List=deconstruct_brep_11.Vertices, Index="1", Wrap=True)
vector_2pt_2 = Vector2Pt(PointA=point, PointB=list_item_24, Unitize=False)  # -> Vector, Length
move_38 = Move(Geometry=mesh, Motion=vector_2pt_2.Vector)  # -> Geometry, Transform
mirror_5 = Mirror(Geometry=[mirror_3.Geometry, move_38.Geometry, move_14.Geometry], Plane=xz_plane)  # -> Geometry, Transform
rh_out_pes = Geometry([mirror_3.Geometry, mirror_5.Geometry, move_14.Geometry, move_38.Geometry])

# ---- group: Peca 8
stream_filter_4 = StreamFilter(Gate=expression_2, Stream1=box_2pt_12, Stream2=[box_2pt_13, box_2pt_11])

# ----
deconstruct_brep_12 = DeconstructBrep(Brep=box_2pt_13)  # -> Faces, Edges, Vertices
dispatch_2 = Dispatch(List=stream_filter_4, DispatchPattern=[True, False])  # -> ListA, ListB
unit_z_27 = UnitZ(Factor=panel_4)
negative_4 = Negative(Value=unit_z_27)
list_item_25 = ListItem(List=deconstruct_brep_12.Vertices, Index=0, Wrap=True)
dispatch_3 = Dispatch(List=stream_filter_4, DispatchPattern=[True, False])  # -> ListA, ListB

# ---- group: Peca 11
linear_array = LinearArray(Geometry=dispatch_2.ListA, Direction=negative_4, Count=cantidad_cajones)  # -> Geometry, Transform

# ---- group: Peca 8
linear_array_2 = LinearArray(Geometry=dispatch_2.ListB, Direction=negative_4, Count=cantidad_cajones)  # -> Geometry, Transform

# ----
move_39 = Move(Geometry=list_item_19, Motion=unit_z_8)  # -> Geometry, Transform
brep_3 = Brep(dispatch_3.ListA)
brep_4 = Brep(dispatch_3.ListB)
deconstruct_brep_13 = DeconstructBrep(Brep=box_2pt_11)  # -> Faces, Edges, Vertices
stream_filter_5 = StreamFilter(Gate=expression_2, Stream1=brep_3, Stream2=brep_4)
deconstruct_brep_14 = DeconstructBrep(Brep=stream_filter_5)  # -> Faces, Edges, Vertices
list_item_26 = ListItem(List=deconstruct_brep_13.Vertices, Index="1", Wrap=True)
move_40 = Move(Geometry=move_39.Geometry, Motion=unit_x_3)  # -> Geometry, Transform
list_item_27 = ListItem(List=deconstruct_brep_13.Vertices, Index="0", Wrap=True)
list_item_28 = ListItem(List=deconstruct_brep_14.Edges, Index=0, Wrap=True)
move_41 = Move(Geometry=list_item_27, Motion=unit_y_7)  # -> Geometry, Transform
move_42 = Move(Geometry=list_item_26, Motion=unit_y_8)  # -> Geometry, Transform
curve_middle_6 = CurveMiddle(Curve=list_item_28)
move_43 = Move(Geometry=move_41.Geometry, Motion=unit_z_9)  # -> Geometry, Transform
move_44 = Move(Geometry=move_42.Geometry, Motion=unit_z_10)  # -> Geometry, Transform
yz_plane_3 = YZPlane(Origin=curve_middle_6)
deconstruct_brep_15 = DeconstructBrep(Brep=box_2pt_12)  # -> Faces, Edges, Vertices
move_45 = Move(Geometry=move_43.Geometry, Motion=unit_x_4)  # -> Geometry, Transform
line_2 = Line(StartPoint=move_40.Geometry, EndPoint=move_45.Geometry)
length_2 = Length(Curve=line_2)
panel_5 = Panel(length_2)
subtraction_4 = Subtraction(A=length_2, B=multiplication)
move_46 = Move(Geometry=move_44.Geometry, Motion=unit_x_5)  # -> Geometry, Transform
list_item_29 = ListItem(List=deconstruct_brep_15.Vertices, Index="0", Wrap=True)
list_item_30 = ListItem(List=deconstruct_brep_15.Vertices, Index="1", Wrap=True)
division_3 = Division(A=subtraction_4, B=cantidad_cajones)
move_47 = Move(Geometry=list_item_29, Motion=unit_y_9)  # -> Geometry, Transform
move_48 = Move(Geometry=list_item_30, Motion=unit_y_10)  # -> Geometry, Transform
panel_6 = Panel(division_3)
addition_3 = Addition(A=panel_6, B="1")
move_49 = Move(Geometry=move_47.Geometry, Motion=unit_z_11)  # -> Geometry, Transform
panel_7 = Panel(addition_3)
unit_z_28 = UnitZ(Factor=panel_7)
negative_5 = Negative(Value=unit_z_28)
move_50 = Move(Geometry=move_46.Geometry, Motion=negative_5)  # -> Geometry, Transform
move_51 = Move(Geometry=move_48.Geometry, Motion=unit_z_12)  # -> Geometry, Transform
move_52 = Move(Geometry=move_50.Geometry, Motion=unit_y_11)  # -> Geometry, Transform
move_53 = Move(Geometry=move_49.Geometry, Motion=unit_x_6)  # -> Geometry, Transform
move_54 = Move(Geometry=move_51.Geometry, Motion=unit_x_7)  # -> Geometry, Transform
box_2pt_14 = Box2Pt(PointA=move_45.Geometry, PointB=move_52.Geometry, Plane=PlaneXY(0, 0, 0))
line_3 = Line(StartPoint=move_53.Geometry, EndPoint=move_40.Geometry)
length_3 = Length(Curve=line_3)
subtraction_5 = Subtraction(A=length_3, B=multiplication_2)
division_4 = Division(A=subtraction_5, B=cantidad_cajones)
panel_8 = Panel(division_4)
addition_4 = Addition(A=panel_8, B="1")
panel_9 = Panel(addition_4)
unit_z_29 = UnitZ(Factor=panel_9)
negative_6 = Negative(Value=unit_z_29)
move_55 = Move(Geometry=move_54.Geometry, Motion=negative_6)  # -> Geometry, Transform
move_56 = Move(Geometry=move_55.Geometry, Motion=unit_y_12)  # -> Geometry, Transform
box_2pt_15 = Box2Pt(PointA=move_53.Geometry, PointB=move_56.Geometry, Plane=PlaneXY(0, 0, 0))
stream_filter_6 = StreamFilter(Gate=expression_2, Stream1=box_2pt_15, Stream2=box_2pt_14)
deconstruct_brep_16 = DeconstructBrep(Brep=stream_filter_6)  # -> Faces, Edges, Vertices
deconstruct_brep_17 = DeconstructBrep(Brep=stream_filter_6)  # -> Faces, Edges, Vertices
list_item_31 = ListItem(List=deconstruct_brep_16.Vertices, Index="7", Wrap=True)
list_item_32 = ListItem(List=deconstruct_brep_17.Vertices, Index="3", Wrap=True)
move_57 = Move(Geometry=list_item_31, Motion=unit_y_13)  # -> Geometry, Transform
deconstruct_brep_18 = DeconstructBrep(Brep=stream_filter_6)  # -> Faces, Edges, Vertices
move_58 = Move(Geometry=list_item_32, Motion=unit_x_8)  # -> Geometry, Transform
list_item_33 = ListItem(List=deconstruct_brep_18.Vertices, Index="3", Wrap=True)
move_59 = Move(Geometry=move_58.Geometry, Motion=unit_z_13)  # -> Geometry, Transform
move_60 = Move(Geometry=list_item_31, Motion=unit_z_14)  # -> Geometry, Transform
list_item_34 = ListItem(List=deconstruct_brep_18.Vertices, Index="2", Wrap=True)
move_61 = Move(Geometry=list_item_33, Motion=unit_z_15)  # -> Geometry, Transform
move_62 = Move(Geometry=list_item_34, Motion=unit_z_16)  # -> Geometry, Transform
line_4 = Line(StartPoint=list_item_31, EndPoint=move_57.Geometry)
line_5 = Line(StartPoint=move_60.Geometry, EndPoint=list_item_31)
line_6 = Line(StartPoint=move_60.Geometry, EndPoint=move_57.Geometry)
line_7 = Line(StartPoint=list_item_31, EndPoint=move_57.Geometry)
line_8 = Line(StartPoint=move_60.Geometry, EndPoint=list_item_31)
line_9 = Line(StartPoint=move_60.Geometry, EndPoint=move_57.Geometry)
move_63 = Move(Geometry=move_61.Geometry, Motion=unit_x_9)  # -> Geometry, Transform
move_64 = Move(Geometry=move_59.Geometry, Motion=unit_z_17)  # -> Geometry, Transform
line_10 = Line(StartPoint=move_53.Geometry, EndPoint=move_54.Geometry)
line_11 = Line(StartPoint=move_45.Geometry, EndPoint=move_46.Geometry)
move_65 = Move(Geometry=move_62.Geometry, Motion=unit_x_10)  # -> Geometry, Transform
join_curves = JoinCurves(Curves=[line_4, line_5, line_6], Preserve=False)
join_curves_2 = JoinCurves(Curves=[line_7, line_8, line_9], Preserve=False)
length_4 = Length(Curve=line_10)
length_5 = Length(Curve=line_11)
unit_x_17 = UnitX(Factor=length_4)
unit_x_18 = UnitX(Factor=length_5)
move_66 = Move(Geometry=move_64.Geometry, Motion=unit_x_11)  # -> Geometry, Transform
move_67 = Move(Geometry=move_65.Geometry, Motion=unit_y_14)  # -> Geometry, Transform
extrude = Extrude(Base=join_curves, Direction=unit_x_17)
extrude_2 = Extrude(Base=join_curves_2, Direction=unit_x_18)
move_68 = Move(Geometry=move_66.Geometry, Motion=unit_y_15)  # -> Geometry, Transform
stream_filter_7 = StreamFilter(Gate=expression_2, Stream1=extrude, Stream2=extrude_2)
box_2pt_16 = Box2Pt(PointA=move_59.Geometry, PointB=move_68.Geometry, Plane=PlaneXY(0, 0, 0))
deconstruct_brep_19 = DeconstructBrep(Brep=box_2pt_16)  # -> Faces, Edges, Vertices

# ---- group: Ranuras Laterales
deconstruct_brep_20 = DeconstructBrep(Brep=box_2pt_16)  # -> Faces, Edges, Vertices
deconstruct_brep_21 = DeconstructBrep(Brep=box_2pt_16)  # -> Faces, Edges, Vertices
unit_z_30 = UnitZ(Factor="12.5")
list_item_35 = ListItem(List=deconstruct_brep_20.Vertices, Index="3", Wrap=True)
list_item_36 = ListItem(List=deconstruct_brep_21.Vertices, Index="0", Wrap=True)
move_69 = Move(Geometry=list_item_35, Motion=unit_z_30)  # -> Geometry, Transform
unit_z_31 = UnitZ(Factor="16.5")
unit_x_19 = UnitX(Factor="6")
unit_x_20 = UnitX(Factor="6")
move_70 = Move(Geometry=list_item_36, Motion=unit_z_31)  # -> Geometry, Transform
move_71 = Move(Geometry=move_69.Geometry, Motion=unit_x_19)  # -> Geometry, Transform
move_72 = Move(Geometry=move_70.Geometry, Motion=unit_x_20)  # -> Geometry, Transform
mirror_6 = Mirror(Geometry=move_72.Geometry, Plane=yz_plane_3)  # -> Geometry, Transform
box_2pt_17 = Box2Pt(PointA=move_71.Geometry, PointB=mirror_6.Geometry, Plane=PlaneXY(0, 0, 0))

# ----
deconstruct_brep_22 = DeconstructBrep(Brep=box_2pt_16)  # -> Faces, Edges, Vertices
list_item_37 = ListItem(List=deconstruct_brep_19.Vertices, Index="7", Wrap=True)
list_item_38 = ListItem(List=deconstruct_brep_22.Edges, Index="4", Wrap=True)
move_73 = Move(Geometry=list_item_37, Motion=unit_y_16)  # -> Geometry, Transform
curve_middle_7 = CurveMiddle(Curve=list_item_38)
box_2pt_18 = Box2Pt(PointA=move_73.Geometry, PointB=list_item_35, Plane=PlaneXY(0, 0, 0))
move_74 = Move(Geometry=curve_middle_7, Motion=unit_z_18)  # -> Geometry, Transform
deconstruct_brep_23 = DeconstructBrep(Brep=box_2pt_18)  # -> Faces, Edges, Vertices
deconstruct_brep_24 = DeconstructBrep(Brep=box_2pt_18)  # -> Faces, Edges, Vertices
area_2 = Area(Geometry=box_2pt_18)  # -> Area, Centroid
move_75 = Move(Geometry=move_74.Geometry, Motion=unit_y_17)  # -> Geometry, Transform
list_item_39 = ListItem(List=deconstruct_brep_24.Vertices, Index="0", Wrap=True)
list_item_40 = ListItem(List=deconstruct_brep_23.Vertices, Index="1", Wrap=True)
yz_plane_4 = YZPlane(Origin=area_2.Centroid)
xz_plane_2 = XZPlane(Origin=move_75.Geometry)
move_76 = Move(Geometry=list_item_40, Motion=Vector(0, 0, 10))  # -> Geometry, Transform
move_77 = Move(Geometry=list_item_39, Motion=unit_z_19)  # -> Geometry, Transform
cylinder = Cylinder(Base=xz_plane_2, Radius="2.5", Length="-27")
area_3 = Area(Geometry=box_2pt_16)  # -> Area, Centroid
move_78 = Move(Geometry=move_76.Geometry, Motion=Vector(0, 0, 10))  # -> Geometry, Transform
xz_plane_3 = XZPlane(Origin=area_3.Centroid)

cap_holes = CapHoles(Brep=cylinder)
move_79 = Move(Geometry=cap_holes, Motion=negative_2)  # -> Geometry, Transform
mirror_7 = Mirror(Geometry=[cap_holes, move_79.Geometry], Plane=xz_plane_3)  # -> Geometry, Transform

# ---- group: Operaciones Frente Cajon
box_2pt_19 = Box2Pt(PointA=move_63.Geometry, PointB=move_67.Geometry, Plane=PlaneXY(0, 0, 0))
cap_holes_2 = CapHoles(Brep=stream_filter_7)
brep_5 = Brep([mirror_7.Geometry, move_79.Geometry, cap_holes])

# ---- group: Frente
solid_difference = SolidDifference(BrepsA=stream_filter_6, BrepsB=flatten([cap_holes_2, box_2pt_19, brep_5]))

# ---- group: Lateral de cajon IZQ
solid_difference_2 = SolidDifference(BrepsA=box_2pt_16, BrepsB=flatten([brep_5, box_2pt_17]))

# ---- group: Lateral de cajon Der
mirror_8 = Mirror(Geometry=solid_difference_2, Plane=yz_plane_3)  # -> Geometry, Transform

# ----
vector_2pt_3 = Vector2Pt(PointA=list_item_27, PointB=list_item_25, Unitize=False)  # -> Vector, Length
rh_out_peça_17 = Geometry([solid_difference_2, mirror_8.Geometry])
move_80 = Move(Geometry=[solid_difference_2, mirror_8.Geometry], Motion=vector_2pt_3.Vector)  # -> Geometry, Transform
rh_in_03_0_equilíbrio_peça_17 = ValueList({"Lado 1": 3, "Lado 2": 1, "2 lados": 6}, selected="Lado 1")
rh_in_03_0_peça_17_borde_superior = ValueList({"Canto": 0, "MDP": 1}, selected="Canto")
rh_in_03_0_peça_17_borde_inferior = ValueList({"Canto": 0, "MDP": 1}, selected="Canto")
stream_filter_8 = StreamFilter(
    Gate=expression_2,
    Stream1=[solid_difference_2, mirror_8.Geometry],
    Stream2=[move_80.Geometry, solid_difference_2, mirror_8.Geometry])
rh_in_03_0_peça_17 = ValueList({"Atravesada": 1, "Longitudinal": 0}, selected="Longitudinal")
dispatch_4 = Dispatch(List=stream_filter_8, DispatchPattern=[True, False])  # -> ListA, ListB
brep_6 = Brep(dispatch_4.ListA)
brep_7 = Brep(dispatch_4.ListB)
dispatch_5 = Dispatch(List=brep_6, DispatchPattern=[True, False])  # -> ListA, ListB
dispatch_6 = Dispatch(List=brep_7, DispatchPattern=[True, False])  # -> ListA, ListB
brep_8 = Brep(dispatch_5.ListA)
brep_9 = Brep(dispatch_5.ListB)
brep_10 = Brep(dispatch_6.ListA)
brep_11 = Brep(dispatch_6.ListB)
cluster = Cluster_3(
    brep=brep_10,
    B=rh_in_03_0_peça_17,
    B_2=rh_in_03_0_peça_17,
    tipo=rh_in_03_0_equilíbrio_peça_17,
    B_3=rh_in_03_0_peça_17,
    gate=rh_in_03_0_peça_17_borde_superior,
    back=rh_in_03_0_equilíbrio_peça_17,
    gate_2=rh_in_03_0_peça_17_borde_inferior)  # -> a, a_2, a_3
cluster_2 = Cluster_3(
    brep=brep_8,
    B=rh_in_03_0_peça_17,
    B_2=rh_in_03_0_peça_17,
    tipo=rh_in_03_0_equilíbrio_peça_17,
    B_3=rh_in_03_0_peça_17,
    gate=rh_in_03_0_peça_17_borde_superior,
    back=rh_in_03_0_equilíbrio_peça_17,
    gate_2=rh_in_03_0_peça_17_borde_inferior)  # -> a, a_2, a_3
cluster_3 = Cluster_3(
    brep=brep_9,
    B=rh_in_03_0_peça_17,
    B_2=rh_in_03_0_peça_17,
    tipo=rh_in_03_0_equilíbrio_peça_17,
    B_3=rh_in_03_0_peça_17,
    gate=rh_in_03_0_peça_17_borde_superior,
    back=rh_in_03_0_equilíbrio_peça_17,
    gate_2=rh_in_03_0_peça_17_borde_inferior)  # -> a, a_2, a_3
cluster_4 = Cluster_3(
    brep=brep_11,
    B=rh_in_03_0_peça_17,
    B_2=rh_in_03_0_peça_17,
    tipo=rh_in_03_0_equilíbrio_peça_17,
    B_3=rh_in_03_0_peça_17,
    gate=rh_in_03_0_peça_17_borde_superior,
    back=rh_in_03_0_equilíbrio_peça_17,
    gate_2=rh_in_03_0_peça_17_borde_inferior)  # -> a, a_2, a_3
relay = Relay([cluster_2.a, cluster_3.a, cluster.a, cluster_4.a])
relay_2 = Relay([cluster_2.a_2, cluster_3.a_2, cluster.a_2, cluster_4.a_2])
relay_3 = Relay([cluster_2.a_3, cluster_3.a_3, cluster.a_3, cluster_4.a_3])
linear_array_3 = LinearArray(Geometry=relay, Direction=negative_4, Count=cantidad_cajones)  # -> Geometry, Transform
linear_array_4 = LinearArray(Geometry=relay_2, Direction=negative_4, Count=cantidad_cajones)  # -> Geometry, Transform
linear_array_5 = LinearArray(Geometry=relay_3, Direction=negative_4, Count=cantidad_cajones)  # -> Geometry, Transform
rh_out_peça_17_b = Geometry()

box_2pt_20 = Box2Pt(PointA=move_77.Geometry, PointB=move_78.Geometry, Plane=PlaneXY(0, 0, 0))

vector_2pt_4 = Vector2Pt(PointA=list_item_27, PointB=list_item_25, Unitize=False)  # -> Vector, Length
move_81 = Move(Geometry=box_2pt, Motion=vector_2pt_4.Vector)  # -> Geometry, Transform
stream_filter_9 = StreamFilter(Gate=expression_2, Stream1=box_2pt, Stream2=[box_2pt, move_81.Geometry])
rh_in_03_0_equilíbrio_peça_18 = ValueList({"Lado 1": 5, "Lado 2": 4, "2 lados": 6}, selected="Lado 1")
rh_in_03_0_peça_18 = ValueList({"Horizontal": 4, "Horizontal Invertida": 5}, selected="Horizontal")
cluster_5 = Cluster(
    brep=stream_filter_9,
    B=rh_in_03_0_peça_18,
    tipo=rh_in_03_0_equilíbrio_peça_18,
    B_2=rh_in_03_0_peça_18,
    B_3=rh_in_03_0_peça_18,
    back=rh_in_03_0_equilíbrio_peça_18)  # -> a, a_2, a_3
linear_array_6 = LinearArray(Geometry=cluster_5.a, Direction=negative_4, Count=cantidad_cajones)  # -> Geometry, Transform
linear_array_7 = LinearArray(Geometry=cluster_5.a_2, Direction=negative_4, Count=cantidad_cajones)  # -> Geometry, Transform
linear_array_8 = LinearArray(Geometry=cluster_5.a_3, Direction=negative_4, Count=cantidad_cajones)  # -> Geometry, Transform
rh_out_peça_18_b = Geometry(linear_array_8.Geometry)
rh_out_peça_18 = Geometry(linear_array_7.Geometry)
rh_out_mdf = Geometry(linear_array_6.Geometry)

# ---- group: Posterior
solid_difference_3 = SolidDifference(BrepsA=box_2pt_18, BrepsB=flatten([brep_5, box_2pt_20]))

# ----
vector_2pt_5 = Vector2Pt(PointA=list_item_27, PointB=list_item_25, Unitize=False)  # -> Vector, Length
move_82 = Move(Geometry=solid_difference_3, Motion=vector_2pt_5.Vector)  # -> Geometry, Transform
stream_filter_10 = StreamFilter(Gate=expression_2, Stream1=solid_difference_3, Stream2=[move_82.Geometry, solid_difference_3])
rh_in_03_0_equilíbrio_peça_16 = ValueList({"Lado 1": 3, "Lado 2": 1, "2 lados": 6}, selected="Lado 1")
rh_in_03_0_peça_16 = ValueList({"Horizontal": 4, "Atravezada": 5}, selected="Horizontal")
cluster_6 = Cluster_2(
    brep=stream_filter_10,
    B=rh_in_03_0_peça_16,
    B_2=rh_in_03_0_peça_16,
    B_3=rh_in_03_0_peça_16,
    color=rh_in_03_0_equilíbrio_peça_16,
    balance=rh_in_03_0_equilíbrio_peça_16)  # -> a, a_2, a_3
linear_array_9 = LinearArray(Geometry=cluster_6.a, Direction=negative_4, Count=cantidad_cajones)  # -> Geometry, Transform
linear_array_10 = LinearArray(Geometry=cluster_6.a_2, Direction=negative_4, Count=cantidad_cajones)  # -> Geometry, Transform
linear_array_11 = LinearArray(Geometry=cluster_6.a_3, Direction=negative_4, Count=cantidad_cajones)  # -> Geometry, Transform
rh_out_peça_16_b = Geometry(linear_array_11.Geometry)
rh_out_mdp = Geometry()

# ---- group: RH_OUT:Peça 16
rh_out_peça_10 = Geometry(linear_array_10.Geometry)

# ----
deconstruct_brep_25 = DeconstructBrep(Brep=box_2pt_16)  # -> Faces, Edges, Vertices
deconstruct_brep_26 = DeconstructBrep(Brep=cap_holes)  # -> Faces, Edges, Vertices
list_item_41 = ListItem(List=deconstruct_brep_25.Edges, Index="9", Wrap=True)
list_item_42 = ListItem(List=deconstruct_brep_26.Edges, Index="0", Wrap=True)
curve_middle_8 = CurveMiddle(Curve=list_item_41)
area_4 = Area(Geometry=list_item_42)  # -> Area, Centroid
vector_2pt_6 = Vector2Pt(PointA=point_4, PointB=list_item_32, Unitize=False)  # -> Vector, Length
vector_2pt_7 = Vector2Pt(PointA=point_3, PointB=curve_middle_8, Unitize=False)  # -> Vector, Length
vector_2pt_8 = Vector2Pt(PointA=point_3, PointB=curve_middle_8, Unitize=False)  # -> Vector, Length
vector_2pt_9 = Vector2Pt(PointA=point_2, PointB=area_4.Centroid, Unitize=False)  # -> Vector, Length
move_83 = Move(Geometry=maquinados, Motion=vector_2pt_6.Vector)  # -> Geometry, Transform
move_84 = Move(Geometry=corredeça, Motion=vector_2pt_6.Vector)  # -> Geometry, Transform
move_85 = Move(Geometry=corredeça_2, Motion=vector_2pt_6.Vector)  # -> Geometry, Transform
move_86 = Move(Geometry=corredeça_3, Motion=vector_2pt_6.Vector)  # -> Geometry, Transform
move_87 = Move(Geometry=corredeça_4, Motion=vector_2pt_6.Vector)  # -> Geometry, Transform
move_88 = Move(Geometry=cantoneira, Motion=vector_2pt_7.Vector)  # -> Geometry, Transform
move_89 = Move(Geometry=parafuso_e, Motion=vector_2pt_8.Vector)  # -> Geometry, Transform
move_90 = Move(Geometry=cavilha, Motion=vector_2pt_9.Vector)  # -> Geometry, Transform

# ---- group: Peça 7
solid_difference_4 = SolidDifference(BrepsA=box_2pt_3, BrepsB=move_83.Geometry)

# ----
mirror_9 = Mirror(Geometry=move_84.Geometry, Plane=yz_plane_4)  # -> Geometry, Transform
mirror_10 = Mirror(Geometry=move_85.Geometry, Plane=yz_plane_4)  # -> Geometry, Transform
mirror_11 = Mirror(Geometry=move_86.Geometry, Plane=yz_plane_4)  # -> Geometry, Transform
mirror_12 = Mirror(Geometry=move_87.Geometry, Plane=yz_plane_4)  # -> Geometry, Transform
mirror_13 = Mirror(Geometry=move_83.Geometry, Plane=yz_plane_4)  # -> Geometry, Transform
move_91 = Move(Geometry=move_90.Geometry, Motion=negative_3)  # -> Geometry, Transform
mirror_14 = Mirror(Geometry=move_89.Geometry, Plane=yz_plane_4)  # -> Geometry, Transform
mirror_15 = Mirror(Geometry=move_88.Geometry, Plane=yz_plane_4)  # -> Geometry, Transform
mirror_16 = Mirror(Geometry=[move_91.Geometry, move_90.Geometry], Plane=xz_plane_3)  # -> Geometry, Transform
rh_out_parafuso_e = Geometry([mirror_15.Geometry, move_88.Geometry])
move_92 = Move(Geometry=mirror_13.Geometry, Motion=unit_x_12)  # -> Geometry, Transform

# ---- group: Peça 6
solid_difference_5 = SolidDifference(BrepsA=box_2pt_4, BrepsB=move_92.Geometry)

# ---- group: Peça 10
solid_difference_6 = SolidDifference(BrepsA=mirror.Geometry, BrepsB=move_92.Geometry)

# ---- group: Peça 1
solid_difference_7 = SolidDifference(BrepsA=box_2pt_5, BrepsB=move_92.Geometry)

# ----
rh_out_clavilha = Geometry([mirror_14.Geometry, move_89.Geometry])
mirror_17 = Mirror(Geometry=[mirror_16.Geometry, move_91.Geometry, move_90.Geometry], Plane=yz_plane_4)  # -> Geometry, Transform
rh_out_cavilha = Geometry([mirror_17.Geometry, move_90.Geometry, move_91.Geometry, mirror_16.Geometry])
cluster_7 = Cluster_4(
    brep=solid_difference_4,
    B=rh_in_03_0_peça_7,
    B_2=rh_in_03_0_peça_7,
    tipo=rh_in_03_0_equilíbrio_peça_7,
    B_3=rh_in_03_0_peça_7,
    back=rh_in_03_0_equilíbrio_peça_7)  # -> a, a_2, a_3
cluster_8 = Cluster_4(
    brep=solid_difference_5,
    B=rh_in_03_0_peça_6,
    B_2=rh_in_03_0_peça_6,
    tipo=rh_in_03_0_equilíbrio_peça_6,
    B_3=rh_in_03_0_peça_6,
    back=rh_in_03_0_equilíbrio_peça_6)  # -> a, a_2, a_3
cluster_9 = Cluster_4(
    brep=solid_difference_6,
    B=rh_in_03_0_peça_10,
    B_2=rh_in_03_0_peça_10,
    tipo=rh_in_03_0_equilíbrio_peça_10,
    B_3=rh_in_03_0_peça_10,
    back=rh_in_03_0_equilíbrio_peça_10)  # -> a, a_2, a_3
rh_out_peça_7 = Geometry(cluster_7.a_2)
rh_out_peça_7_b = Geometry(cluster_7.a_3)
rh_out_peça_10_2 = Geometry(cluster_9.a_2)
rh_out_peça_6 = Geometry(cluster_8.a_2)
rh_out_peça_6_b = Geometry(cluster_8.a_3)
rh_out_peça_10_b = Geometry(cluster_9.a_3)
# Posicionador Borde Superior
# Posicionador Borde Inferior
rh_out_mdp_2 = Geometry([cluster_8.a, cluster_7.a, cluster_9.a, linear_array_3.Geometry])

# ==== cluster Cluster
brep = ClusterInput()
# Descomposicion Malla Tablero Horizontal
deconstruct_brep = DeconstructBrep(Brep=brep)  # -> Faces, Edges, Vertices
tipo = ClusterInput()
back = ClusterInput()
stream_filter = StreamFilter(Gate=tipo, Stream4=["0", "1", "3", "5"], Stream5=["0", "1", "3", "4"], Stream6=["0", "1", "3", "4", "5"])
stream_filter_2 = StreamFilter(Gate=back, Stream4="4", Stream5="5")
list_length = ListLength(List=deconstruct_brep.Faces)
partes = Panel(list_length)
list_item = ListItem(List=deconstruct_brep.Faces, Index=stream_filter, Wrap=True)
list_item_2 = ListItem(List=deconstruct_brep.Faces, Index=stream_filter_2, Wrap=True)
subtraction = Subtraction(A=partes, B="6")
series = Series(Start="6", Step="1", Count=subtraction)
list_item_3 = ListItem(List=deconstruct_brep.Faces, Index=[series, "2"], Wrap=True)
mesh_brep = MeshBrep(
    Brep=list_item_3,
    Settings={GridMaxCount=0, GridMinCount=16, JaggedSeams=False, MaxEdgeLength=0, MinEdgeLength=0.0001, MinTolerance=0, Refine=True, RefineAngle=0, RelativeTolerance=0.65, SimplePlanes=True, Tolerance=0})
mesh_brep_2 = MeshBrep(
    Brep=list_item,
    Settings={GridMaxCount=0, GridMinCount=16, JaggedSeams=False, MaxEdgeLength=0, MinEdgeLength=0.0001, MinTolerance=0, Refine=True, RefineAngle=0, RelativeTolerance=0.65, SimplePlanes=True, Tolerance=0})
mesh_brep_3 = MeshBrep(
    Brep=list_item_2,
    Settings={GridMaxCount=0, GridMinCount=16, JaggedSeams=False, MaxEdgeLength=0, MinEdgeLength=0.0001, MinTolerance=0, Refine=True, RefineAngle=0, RelativeTolerance=0.65, SimplePlanes=True, Tolerance=0})
mesh_join = MeshJoin(Meshes=flatten(mesh_brep))
mesh_join_2 = MeshJoin(Meshes=mesh_brep_2)
mesh_join_3 = MeshJoin(Meshes=mesh_brep_3)
B = ClusterInput()
B_2 = ClusterInput()
B_3 = ClusterInput()
python_3_script = Python3Script(M=mesh_join, B=B)  # -> a; inputs M: Mesh, B: Int32
# ---------- python_3_script: Python ----------
import Rhino

def aplicar_box_mapping_profesional(mesh_in, modo_veta=0, escala_caja_mm=600.0):
    if mesh_in is None:
        return None
        
    mesh = mesh_in.DuplicateMesh() if hasattr(mesh_in, "DuplicateMesh") else mesh_in
    if not isinstance(mesh, Rhino.Geometry.Mesh):
        return mesh_in

    # 1. Desoldar aristas vivas para separar las 6 caras
    mesh.Unweld(0.0, True)
    mesh.Normals.ComputeNormals()
    mesh.TextureCoordinates.Clear()

    # 2. Medir BoundingBox real de la pieza en mm
    bbox = mesh.GetBoundingBox(True)
    sx = max(1.0, bbox.Max.X - bbox.Min.X)
    sy = max(1.0, bbox.Max.Y - bbox.Min.Y)
    sz = max(1.0, bbox.Max.Z - bbox.Min.Z)

    # Identificar el espesor (menor dimensión, ej: 15 mm)
    min_dim = min(sx, sy, sz)

    # 3. Detectar si la cara principal es Atravesada (1) o Longitudinal (0)
    es_atravesada = False
    if isinstance(modo_veta, str):
        es_atravesada = "atravesad" in modo_veta.lower() or modo_veta in ["1", "3", "5"]
    elif isinstance(modo_veta, (int, float)):
        es_atravesada = int(modo_veta) in [1, 3, 5]

    escala = float(escala_caja_mm)

    # 4. Asignar UVs: Las caras rotan con el selector, los 4 cantos SIEMPRE corren a lo largo del borde
    for idx in range(mesh.Vertices.Count):
        v = mesh.Vertices[idx]
        n = mesh.Normals[idx] if idx < mesh.Normals.Count else Rhino.Geometry.Vector3f(0, 0, 1)
        
        lx = v.X - bbox.Min.X
        ly = v.Y - bbox.Min.Y
        lz = v.Z - bbox.Min.Z
        
        nx, ny, nz = abs(n.X), abs(n.Y), abs(n.Z)

        # -------------------------------------------------------------
        # CASO 1: Tablero Horizontal (Cubiertas, Entrepaños - Espesor en Z)
        # -------------------------------------------------------------
        if min_dim == sz:
            if nz >= nx and nz >= ny:
                # Caras Principales (Superior / Inferior) -> Responde a Longitudinal / Atravesada
                u = ly / escala if es_atravesada else lx / escala
                v_coord = lx / escala if es_atravesada else ly / escala
            elif ny >= nx and ny >= nz:
                # Canto Frontal / Trasero -> Veta corre a lo largo del ancho X
                u = lx / escala
                v_coord = lz / escala
            else:
                # Canto Lateral Izq / Der -> Veta corre a lo largo de la profundidad Y
                u = ly / escala
                v_coord = lz / escala

        # -------------------------------------------------------------
        # CASO 2: Tablero Vertical Lateral (Costados, Laterales - Espesor en X)
        # -------------------------------------------------------------
        elif min_dim == sx:
            if nx >= ny and nx >= nz:
                # Caras Principales (Caras exteriores e interiores)
                u = lz / escala if es_atravesada else ly / escala
                v_coord = ly / escala if es_atravesada else lz / escala
            elif ny >= nx and ny >= nz:
                # Canto Frontal / Trasero -> Veta corre a lo largo de la altura Z
                u = lz / escala
                v_coord = lx / escala
            else:
                # Canto Superior / Inferior -> Veta corre a lo largo de la profundidad Y
                u = ly / escala
                v_coord = lx / escala

        # -------------------------------------------------------------
        # CASO 3: Tablero Vertical Frontal (Frentes de Cajón, Tapa Luz, Puertas - Espesor en Y)
        # -------------------------------------------------------------
        else:
            if ny >= nx and ny >= nz:
                # Caras Principales (Frente y Trasera) -> Responde a Longitudinal / Atravesada
                u = lz / escala if es_atravesada else lx / escala
                v_coord = lx / escala if es_atravesada else lz / escala
            elif nz >= nx and nz >= ny:
                # Canto Superior / Inferior -> Veta corre a lo largo del ancho X
                u = lx / escala
                v_coord = ly / escala
            else:
                # Canto Lateral Izq / Der -> Veta corre a lo largo de la altura Z
                u = lz / escala
                v_coord = ly / escala

        mesh.TextureCoordinates.Add(float(u), float(v_coord))
        
    return mesh


if isinstance(M, list):
    resultado = [aplicar_box_mapping_profesional(item, B, 600.0) for item in M if item is not None]
else:
    resultado = aplicar_box_mapping_profesional(M, B, 600.0)

a = resultado
# ---------- end python_3_script ----------
python_3_script_2 = Python3Script(M=mesh_join_2, B=B_2)  # -> a; inputs M: Mesh, B: Int32; same code as python_3_script
python_3_script_3 = Python3Script(M=mesh_join_3, B=B_3)  # -> a; inputs M: Mesh, B: Int32; same code as python_3_script
a = ClusterOutput(python_3_script)
a_2 = ClusterOutput(python_3_script_2)
a_3 = ClusterOutput(python_3_script_3)

# ==== cluster Cluster_2
# Pieza tipo Frontal
brep = ClusterInput()
deconstruct_brep = DeconstructBrep(Brep=brep)  # -> Faces, Edges, Vertices
balance = ClusterInput()
color = ClusterInput()
stream_filter = StreamFilter(Balance=balance, Stream1="0", Stream3="2")
stream_filter_2 = StreamFilter(Color=color, Stream1=["5", "2"], Stream3=["0", "5"], Stream6=["0", "2", "5"])
list_length = ListLength(List=deconstruct_brep.Faces)
cantidad_de_caras = Panel(list_length)
list_item = ListItem(List=deconstruct_brep.Faces, Index=stream_filter, Wrap=True)
list_item_2 = ListItem(List=deconstruct_brep.Faces, Index=stream_filter_2, Wrap=True)
subtraction = Subtraction(A=cantidad_de_caras, B="6")
series = Series(Start="6", Step="1", Count=subtraction)
list_item_3 = ListItem(List=deconstruct_brep.Faces, Index=[series, "3", "4", "1"], Wrap=True)
mesh_brep = MeshBrep(
    Color=list_item_2,
    Settings={GridMaxCount=0, GridMinCount=16, JaggedSeams=False, MaxEdgeLength=0, MinEdgeLength=0.0001, MinTolerance=0, Refine=True, RefineAngle=0, RelativeTolerance=0.65, SimplePlanes=True, Tolerance=0})
mesh_brep_2 = MeshBrep(
    Balance=list_item,
    Settings={GridMaxCount=0, GridMinCount=16, JaggedSeams=False, MaxEdgeLength=0, MinEdgeLength=0.0001, MinTolerance=0, Refine=True, RefineAngle=0, RelativeTolerance=0.65, SimplePlanes=True, Tolerance=0})
mesh_brep_3 = MeshBrep(
    Brep=list_item_3,
    Settings={GridMaxCount=0, GridMinCount=16, JaggedSeams=False, MaxEdgeLength=0, MinEdgeLength=0.0001, MinTolerance=0, Refine=True, RefineAngle=0, RelativeTolerance=0.65, SimplePlanes=True, Tolerance=0})
mesh_join = MeshJoin(Meshes=flatten(mesh_brep_3))
mesh_join_2 = MeshJoin(Meshes=mesh_brep)
mesh_join_3 = MeshJoin(Meshes=mesh_brep_2)
B = ClusterInput()
B_2 = ClusterInput()
B_3 = ClusterInput()
python_3_script = Python3Script(M=mesh_join, B=B)  # -> a; inputs M: Mesh, B: Int32; same code as python_3_script
python_3_script_2 = Python3Script(M=mesh_join_2, B=B_2)  # -> a; inputs M: Mesh, B: Int32; same code as python_3_script
python_3_script_3 = Python3Script(M=mesh_join_3, B=B_3)  # -> a; inputs M: Mesh, B: Int32; same code as python_3_script
a = ClusterOutput(python_3_script)
a_2 = ClusterOutput(python_3_script_2)
a_3 = ClusterOutput(python_3_script_3)

# ==== cluster Cluster_3
brep = ClusterInput()
tipo = ClusterInput()
back = ClusterInput()
gate = ClusterInput()
gate_2 = ClusterInput()
B = ClusterInput()
B_2 = ClusterInput()
B_3 = ClusterInput()

# ----
# Descomposicion Laterales Cajon
deconstruct_brep = DeconstructBrep(Brep=brep)  # -> Faces, Edges, Vertices
stream_filter = StreamFilter(Gate=tipo, Stream1=["0", "3"], Stream3=["0", "1"], Stream6=["0", "1", "3"])
stream_filter_2 = StreamFilter(Gate=back, Stream1="1", Stream3="3")
list_length = ListLength(List=deconstruct_brep.Faces)
partes = Panel(list_length)
number_slider = Slider(4, range=0..20)
list_item = ListItem(List=deconstruct_brep.Faces, Index=stream_filter_2, Wrap=True)
list_item_2 = ListItem(List=deconstruct_brep.Faces, Index=stream_filter, Wrap=True)
subtraction = Subtraction(A=partes, B="6")
series = Series(Start="6", Step="1", Count=subtraction)
list_item_3 = ListItem(List=deconstruct_brep.Faces, Index="4", Wrap=True)
list_item_4 = ListItem(List=deconstruct_brep.Faces, Index="5", Wrap=True)
list_item_5 = ListItem(List=deconstruct_brep.Faces, Index=[series, "5", "4"], Wrap=True)
stream_gate = StreamGate(Stream=list_item_4, Gate=gate)  # -> Target0, Target1
stream_gate_2 = StreamGate(Stream=list_item_3, Gate=gate_2)  # -> Target0, Target1
solid_union = SolidUnion(Breps=[list_item_2, stream_gate.Target0, stream_gate_2.Target0])
mesh_brep = MeshBrep(
    Color=solid_union,
    Settings={GridMaxCount=0, GridMinCount=16, JaggedSeams=False, MaxEdgeLength=0, MinEdgeLength=0.0001, MinTolerance=0, Refine=True, RefineAngle=0, RelativeTolerance=0.65, SimplePlanes=True, Tolerance=0})
mesh_brep_2 = MeshBrep(
    Brep=list_item,
    Settings={GridMaxCount=0, GridMinCount=16, JaggedSeams=False, MaxEdgeLength=0, MinEdgeLength=0.0001, MinTolerance=0, Refine=True, RefineAngle=0, RelativeTolerance=0.65, SimplePlanes=True, Tolerance=0})
mesh_join = MeshJoin(Meshes=mesh_brep)
mesh_join_2 = MeshJoin(Meshes=mesh_brep_2)
python_3_script = Python3Script(M=mesh_join, B=B_2)  # -> a; inputs M: Mesh, B: Int32; same code as python_3_script
python_3_script_2 = Python3Script(M=mesh_join_2, B=B_3)  # -> a; inputs M: Mesh, B: Int32; same code as python_3_script

stream_filter_3 = StreamFilter(Gate=gate, Stream1=list_item_5)

mesh_brep_3 = MeshBrep(
    Brep=stream_filter_3,
    Settings={GridMaxCount=0, GridMinCount=16, JaggedSeams=False, MaxEdgeLength=0, MinEdgeLength=0.0001, MinTolerance=0, Refine=True, RefineAngle=0, RelativeTolerance=0.65, SimplePlanes=True, Tolerance=0})
mesh_join_3 = MeshJoin(Meshes=flatten(mesh_brep_3))
python_3_script_3 = Python3Script(M=mesh_join_3, B=B)  # -> a; inputs M: Mesh, B: Int32; same code as python_3_script

a = ClusterOutput(python_3_script_3)
a_2 = ClusterOutput(python_3_script)
a_3 = ClusterOutput(python_3_script_2)

# ==== cluster Cluster_4
brep = ClusterInput()
tipo = ClusterInput()
back = ClusterInput()
B = ClusterInput()
B_2 = ClusterInput()
B_3 = ClusterInput()

# ----
# Descomposicion Parales
deconstruct_brep = DeconstructBrep(Brep=brep)  # -> Faces, Edges, Vertices
stream_filter = StreamFilter(Gate=tipo, Stream1=["0", "3"], Stream3=["0", "1"], Stream6=["0", "1", "3"])
stream_filter_2 = StreamFilter(Gate=back, Stream1="1", Stream3="3")
list_length = ListLength(List=deconstruct_brep.Faces)
partes = Panel(list_length)
list_item = ListItem(List=deconstruct_brep.Faces, Index=stream_filter, Wrap=True)
list_item_2 = ListItem(List=deconstruct_brep.Faces, Index=stream_filter_2, Wrap=True)
subtraction = Subtraction(A=partes, B="6")
series = Series(Start="6", Step="1", Count=subtraction)
list_item_3 = ListItem(List=deconstruct_brep.Faces, Index=[series, "2", "4", "5"], Wrap=True)
mesh_brep = MeshBrep(
    Brep=list_item_3,
    Settings={GridMaxCount=0, GridMinCount=16, JaggedSeams=False, MaxEdgeLength=0, MinEdgeLength=0.0001, MinTolerance=0, Refine=True, RefineAngle=0, RelativeTolerance=0.65, SimplePlanes=True, Tolerance=0})
mesh_brep_2 = MeshBrep(
    Color=list_item,
    Settings={GridMaxCount=0, GridMinCount=16, JaggedSeams=False, MaxEdgeLength=0, MinEdgeLength=0.0001, MinTolerance=0, Refine=True, RefineAngle=0, RelativeTolerance=0.65, SimplePlanes=True, Tolerance=0})
mesh_join = MeshJoin(Meshes=flatten(mesh_brep))
mesh_join_2 = MeshJoin(Meshes=mesh_brep_2)
mesh_brep_3 = MeshBrep(
    Brep=list_item_2,
    Settings={GridMaxCount=0, GridMinCount=16, JaggedSeams=False, MaxEdgeLength=0, MinEdgeLength=0.0001, MinTolerance=0, Refine=True, RefineAngle=0, RelativeTolerance=0.65, SimplePlanes=True, Tolerance=0})
mesh_join_3 = MeshJoin(Meshes=mesh_brep_3)
python_3_script = Python3Script(M=mesh_join, B=B)  # -> a; inputs M: Mesh, B: Int32; same code as python_3_script
python_3_script_2 = Python3Script(M=mesh_join_2, B=B_2)  # -> a; inputs M: Mesh, B: Int32; same code as python_3_script
python_3_script_3 = Python3Script(M=mesh_join_3, B=B_3)  # -> a; inputs M: Mesh, B: Int32; same code as python_3_script

a = ClusterOutput(python_3_script)
a_2 = ClusterOutput(python_3_script_2)
a_3 = ClusterOutput(python_3_script_3)
